# Requirement set cruise_control_reqset (R2022b)

## 1 [R1] Max input throttle %
The maximum input throttle is 00%

## 2 [R2] Cruise control speed operation range
Cruise control has a minimum and maximum operating speed

### 2.1 [R2.1] Minimum vehicle speed
The speed of the vehicle must be at least 40km/h for the cruise control system to engage