% Simulink data dictionary crs_plantdic.sldd

uptab = [10 30 50 1000000
 10 30 50 1000000
 15 30 50 1000000
 23 41 60 1000000
 40 70 100 1000000
 40 70 100 1000000]

upth = [0; 25; 35; 50; 90; 100]

downtab = [0 5 20 35
 0 5 20 35
 0 5 25 40
 0 5 30 50
 0 30 50 80
 0 30 50 80]

downth = [0; 5; 40; 50; 90; 100]