# Requirement set crs_req_safety_spec (R2022b)

## 1 [#1] Maximum Throttle Value
Maximum value for the throttle should be equal to or less than 100.

## 2 [#2] Minimum Throttle Value
Minimum Throttle value must not be less than 0.

## 3 [#3] Maximum Target Speed
Maximum value for target speed should be equal to or less than 100.

## 4 [#4] Minimum Target Speed
Minimum target speed must not be less than 40.