% Requirement links of crs_controller.slx (R2022b)

model implements crs_req_func_spec.slreqx#9
block :1 implements crs_req_func_spec.slreqx#9
block :12 implements crs_req_func_spec.slreqx#19: #19: Cruise Control Mode
block :137 implements crs_req_func_spec.slreqx#26: #26: Disable conditions
block :168 implements crs_req_func_spec.slreqx#27: #27: Enable conditions
block :19 implements crs_req_func_spec.slreqx#36: #36: Disabling override
block :198 implements crs_req_func_spec.slreqx#30: #30: Repeating previous operation mode
block :199 implements crs_req_func_spec.slreqx#28: #28: Resume conditions
block :21 implements crs_req_func_spec.slreqx#20: #20: Disable Cruise Control system
block :233 implements crs_req_func_spec.slreqx#35: #35: Out of speed range detection
block :241 implements crs_req_func_spec.slreqx#1: #1: Driver Switch Request Handling
block :249 implements crs_req_func_spec.slreqx#7: #7: Cancel Switch Detection
block :25 implements crs_req_func_spec.slreqx#21: #21: Key position is not ON
block :250 implements crs_req_func_spec.slreqx#9: #9: Enable Switch Detection
block :251 implements crs_req_func_spec.slreqx#8: #8: Set Switch Detection
block :252 implements crs_req_func_spec.slreqx#10: #10: Resume Switch Detection
block :254 implements crs_req_func_spec.slreqx#7: #7: Cancel Switch Detection
block :255 implements crs_req_func_spec.slreqx#9: #9: Enable Switch Detection
block :256 implements crs_req_func_spec.slreqx#8: #8: Set Switch Detection
block :257 implements crs_req_func_spec.slreqx#10: #10: Resume Switch Detection
block :258 implements crs_req_func_spec.slreqx#15: #15: Decrement Switch Detection
block :262 implements crs_req_func_spec.slreqx#16: #16: Decrement Short Switch Detection
block :265 implements crs_req_func_spec.slreqx#4: #4: Long Switch recognition
block :265 implements crs_req_func_spec.slreqx#17: #17: Decrement Long Switch Detection
block :266 implements crs_req_func_spec.slreqx#6: #6: Waiting state for Long Decrement switch detection
block :266 implements crs_req_func_spec.slreqx#18: #18: Intermediate state
block :272 implements crs_req_func_spec.slreqx#6: #6: Waiting state for Long Decrement switch detection
block :280 implements crs_req_func_spec.slreqx#3: #3: Avoid repreading commands
block :297 implements crs_req_func_spec.slreqx#11: #11: Increment Switch Detection
block :3 implements crs_req_func_spec.slreqx#8
block :30 implements crs_req_func_spec.slreqx#22: #22: Gear position is not Drive
block :301 implements crs_req_func_spec.slreqx#12: #12: Increment Short Switch Detection
block :304 implements crs_req_func_spec.slreqx#13: #13: Increment Long Switch Detection
block :305 implements crs_req_func_spec.slreqx#14: #14: Intermediate state
block :320 implements crs_req_func_spec.slreqx#37: #37: Calculate Target Speed and Throttle Value
block :324 implements crs_req_func_spec.slreqx#39: #39: Enabled case
block :325 implements crs_req_func_spec.slreqx#40: #40: Activated case
block :328 implements crs_req_func_spec.slreqx#43: #43: Resume mode
block :329 implements crs_req_func_spec.slreqx#39: #39: Enabled case
block :330 implements crs_req_func_spec.slreqx#40: #40: Activated case
block :331 implements crs_req_func_spec.slreqx#43: #43: Resume mode
block :335 implements crs_req_func_spec.slreqx#40: #40: Activated case
block :341 implements crs_req_func_spec.slreqx#42: #42: Next Target Speed Computation
block :35 implements crs_req_func_spec.slreqx#20: #20: Disable Cruise Control system
block :36 implements crs_req_func_spec.slreqx#23: #23: Brake pressure is higher than brake_threshold
block :360 implements crs_req_func_spec.slreqx#69: #69: Maximum Target Speed
block :360 implements crs_req_func_spec.slreqx#70: #70: Minimum Target Speed
block :366 implements crs_req_func_spec.slreqx#41: #41: Throttle Value Computation
block :376 implements crs_req_func_spec.slreqx#65: #65: Integral of PI
block :377 implements crs_req_func_spec.slreqx#64: #64: Propotional of PI
block :38 implements crs_req_func_spec.slreqx#66: #66: Threshold of brake pressure
block :380 implements crs_req_func_spec.slreqx#68: #68: Minimum Throttle Value
block :380 implements crs_req_func_spec.slreqx#67: #67: Maximum Throttle Value
block :394 implements crs_req_func_spec.slreqx#38: #38: Disabled case
block :400 implements crs_req_func_spec.slreqx#39: #39: Enabled case
block :406 implements crs_req_func_spec.slreqx#43: #43: Resume mode
block :49 implements crs_req_func_spec.slreqx#24: #24: Operation mode determination
block :70 implements crs_req_func_spec.slreqx#34: #34: Decrement and hold mode
block :71 implements crs_req_func_spec.slreqx#31: #31: Increment mode
block :72 implements crs_req_func_spec.slreqx#32: #32: Increment and hold mode
block :73 implements crs_req_func_spec.slreqx#33: #33: Decrement mode
block :75 implements crs_req_func_spec.slreqx#31: #31: Increment mode
block :78 implements crs_req_func_spec.slreqx#33: #33: Decrement mode
block :80 implements crs_req_func_spec.slreqx#32: #32: Increment and hold mode
block :81 implements crs_req_func_spec.slreqx#34: #34: Decrement and hold mode
block :87 implements crs_req_func_spec.slreqx#25: #25: Precedence of mode determination
block :88 implements crs_req_func_spec.slreqx#25: #25: Precedence of mode determination
block :89 implements crs_req_func_spec.slreqx#25: #25: Precedence of mode determination
block :90 implements crs_req_func_spec.slreqx#25: #25: Precedence of mode determination
block :91 implements crs_req_func_spec.slreqx#25: #25: Precedence of mode determination
block :92 implements crs_req_func_spec.slreqx#29: #29: Activate conditions
urn:uuid::71:13 verifies crs_req_safety_spec.slreqx#1
urn:uuid::71:13 verifies crs_req_safety_spec.slreqx#2
urn:uuid::71:13 verifies crs_req_safety_spec.slreqx#3
urn:uuid::71:13 verifies crs_req_safety_spec.slreqx#4
urn:uuid::71:42 verifies crs_req_safety_spec.slreqx#1
urn:uuid::71:42 verifies crs_req_safety_spec.slreqx#2
urn:uuid::71:42 verifies crs_req_safety_spec.slreqx#3
urn:uuid::71:42 verifies crs_req_safety_spec.slreqx#4