% Requirement links of crs_plant.slx (R2021a)

block :262 relates to crs_req_func_spec.slreqx#56: Throttle from Driver
block :262 relates to crs_req.docx#?Other inputs: Other inputs: Other inputs
block :263 relates to crs_req.docx#?System outputs: System outputs: System outputs
block :413:2 relates to crs_req_func_spec.slreqx#55: Gear position
block :455 relates to crs_req.docx#?Other inputs: Other inputs: Other inputs
block :455 relates to crs_req_func_spec.slreqx#53: Vehicle speed
block :75 relates to crs_req.docx#?System outputs: System outputs: System outputs
block :77 relates to crs_req_func_spec.slreqx#52: Brake pressure