% Requirement links of DriverSwRequest_Tests.mldatx (R2022b)

item 1 verifies crs_req_func_spec.slreqx#11: #11: Increment Switch Detection
item 1 verifies crs_req_func_spec.slreqx#12: #12: Increment Short Switch Detection
item 2 verifies crs_req_func_spec.slreqx#13: #13: Increment Long Switch Detection
item 3 verifies crs_req_func_spec.slreqx#9: #9: Enable Switch Detection
item 4 verifies crs_req_func_spec.slreqx#17: #17: Decrement Long Switch Detection
item 5 verifies crs_req_func_spec.slreqx#7: #7: Cancel Switch Detection
item 6 verifies crs_req_func_spec.slreqx#15: #15: Decrement Switch Detection
item 6 verifies crs_req_func_spec.slreqx#16: #16: Decrement Short Switch Detection